# Grasshopper definition EvolutiveCocoon.gh (Grasshopper 1.0.7)
# plug-ins: MarchingCubes, Pufferfish

pt = Point([Point(-179.3170146, 141.4258129, 0), Point(-149.2470962, -163.4622064, 0), Point(195.5967723, -198.4650465, 0), Point(151.6071352, 164.8685815, 0), Point(38.35301919, 4.498233866, 0)])
scale = Panel("0.1")
height = GetNumber(Slider(350, range=350..1000), AtLeast=1, AtMost=2147483647, Maximum=1.797693135e+308, Minimum=-1.797693135e+308)
points = GetPoint(pt, AtLeast=1, AtMost=2147483647, Realtime=True)
dimension = GetNumber(Slider(800, range=350..1000), AtLeast=1, AtMost=2147483647, Maximum=1.797693135e+308, Minimum=-1.797693135e+308)
dom = ConstructDomain(DomainStart=expr("-x/2", dimension), DomainEnd=expr("x/2", dimension))
Z = UnitZ(Factor=height)
rectangle = Rectangle(Plane=PlaneXY(0, 0, 0), XSize=dom, YSize=dom, Radius=0)  # -> Rectangle, Length
move = Move(Geometry=rectangle.Rectangle, Motion=Z)  # -> Geometry, Transform

# ---- group: RH_OUT:limit
crv = Curve(rectangle.Rectangle)

# ----
scale_2 = Scale(Geometry=points, Center=Point(0, 0, 0), Factor=scale)  # -> Geometry, Transform
scale_3 = Scale(Geometry=move.Geometry, Center=Point(0, 0, 0), Factor=scale)  # -> Geometry, Transform
sp_radius2 = GetNumber(Slider(6, range=0..60), AtLeast=1, AtMost=2147483647, Maximum=1.797693135e+308, Minimum=-1.797693135e+308)
sp_radius3 = GetNumber(Slider(7, range=0..60), AtLeast=1, AtMost=2147483647, Maximum=1.797693135e+308, Minimum=-1.797693135e+308)
sp_radius1 = GetNumber(Slider(9, range=0..60), AtLeast=1, AtMost=2147483647, Maximum=1.797693135e+308, Minimum=-1.797693135e+308)
sp_radius4 = GetNumber(Slider(4, range=0..60), AtLeast=1, AtMost=2147483647, Maximum=1.797693135e+308, Minimum=-1.797693135e+308)
sp_radius5 = GetNumber(Slider(4, range=0..60), AtLeast=1, AtMost=2147483647, Maximum=1.797693135e+308, Minimum=-1.797693135e+308)
pop2d = Populate2D(Region=scale_3.Geometry, Count="10", Seed=1)
merge = Merge(Data1=sp_radius1, Data2=sp_radius2, Data3=sp_radius3, Data4=sp_radius4, Data5=sp_radius5)
cp = ClosestPoint(Point=scale_2.Geometry, Cloud=pop2d)  # -> ClosestPoint, CPIndex, Distance
point_charge = PointCharge(Point=cp.ClosestPoint, Radius=merge, ChargeStrength=1)
boolean_toggle = BooleanToggle(True)
cocoon = Cocoon(Charges=point_charge, Iso="0.17", CellSize="10", Execute=boolean_toggle, Simple=False)  # -> Mesh, RefinementData
multiplication = Multiplication(A="10", B="0.8")
refine = Refine(
    RefinementData=cocoon.RefinementData,
    Samples=multiplication,
    SampleSize="15",
    SampleTolerance="0.01",
    LaplacianSmoothing="10",
    ValencePasses="10",
    SubD="1",
    Execute=boolean_toggle)
mesh = Mesh(refine)
box = Box(mesh)
deconstruct_brep = DeconstructBrep(Brep=box)  # -> Faces, Edges, Vertices
list_item = ListItem(List=reverse(deconstruct_brep.Faces), Index=0, Wrap=True)
list_item_2 = ListItem(List=reverse(deconstruct_brep.Edges), Index=0, Wrap=True)
length = Length(Curve=list_item_2)
division = Division(A=length, B=2)
unit_z = UnitZ(Factor=division)
negative = Negative(Value=unit_z)
unit_z_2 = UnitZ(Factor="50")
move_2 = Move(Geometry=list_item, Motion=negative)  # -> Geometry, Transform
offset_mesh = OffsetMesh(Mesh=move_2.Geometry, Distance=expr("-x", unit_z_2), BothSides=False, CreateSolid=True)
mesh_split = MeshSplit(Mesh=mesh, Splitters=offset_mesh)
list_item_3 = ListItem(List=mesh_split, Index=0, Wrap=True)  # -> Item, Item1

# ---- group: RH_OUT:mesh
mesh_2 = Mesh(list_item_3.Item1)

# ----
face_boundaries = FaceBoundaries(Mesh=mesh_2)
scale_4 = Scale(Geometry=face_boundaries, Center=Point(0, 0, 0), Factor="3")  # -> Geometry, Transform

crv_2 = Curve(simplify(scale_4.Geometry))
midpt = CurveMiddle(Curve=crv_2)
pdecon = Deconstruct(Point=midpt)  # -> XComponent, YComponent, ZComponent
bnd = Bounds(Numbers=pdecon.ZComponent)
dedomain = DeconstructDomain(Domain=bnd)  # -> Start, End
gradient = Gradient(
    LowerLimit=0,
    UpperLimit=dedomain.End,
    Parameter=pdecon.ZComponent,
    stops=[0.125: RGB(0, 0, 0), 0.499: RGB(154, 205, 50), 0.926: RGB(220, 20, 60)])
c_script = CSharpScript(crv=crv_2, color=gradient)  # -> out, A; inputs crv: Curve, color: Color
# ---------- c_script: C# ----------
    var c = color.R + "," + color.G + "," + color.B;
    crv.SetUserString("color", c);
    A = crv;
# ---------- end c_script ----------
preview = CustomPreview(Geometry=crv_2, Material=gradient)

# ---- group: RH_OUT:crvs
crv_3 = Curve(c_script.A)
